# Grasshopper definition latent_space_vis_demo_fixed.gh (Grasshopper 1.0.7)
# plug-ins: SonicMat, GH_CPython, RhinoCodePluginGH

number_slider = Slider(3, range=2..3)
encoder = Encoder(
    num_components_input=Slider(3, range=2..3),
    n_dim_input=number_slider,
    perplexity_input=Slider(5, range=0..100),
    learning_rate_input=Slider(100, range=0..100),
    scale_input=Slider(10, range=0..10))  # -> pts_output, dir_output; inputs num_components_input: list, n_dim_input: list, perplexity_input: list, learning_rate_input: list, scale_input: list
#   port pts_output: indicate your output description here. refers to a new line.
# ---------- encoder: Python ----------
import sys
# 1. 强行把你的 aalu 虚拟环境的包路径注入到当前运行内存中
sys.path.append(r'D:\Anaconda3\envs\aalu\Lib\site-packages')
# 2. 补充底层 C++ 动态链接库 (DLL) 的路径，防止 cv2 和 numpy 报深层错误
sys.path.append(r'D:\Anaconda3\envs\aalu\Library\bin')
sys.path.append(r'D:\Anaconda3\envs\aalu')

# --- 注入完毕，下面接着写你原本的代码 ---
import os
import numpy as np
import cv2 as cv
from skimage import color
from sklearn.decomposition import PCA
from sklearn import manifold
from glob import glob
import time


import os
import numpy as np
import cv2 as cv
from skimage import color
from sklearn.decomposition import PCA
from sklearn import manifold
from glob import glob
import time

# Inputs from Grasshopper:
# Ensure these variables match the inputs connected in Grasshopper
# folder_path = folder_path_input  # Input folder path from the Grasshopper panel
folder_path = r'D:\Claude_jiajia\comfyui_reference\comfyui_reference_128'

num_components = num_components_input  # PCA components from number slider
n_dim = n_dim_input                    # t-SNE components (3D visualisation) from slider
perplexity = perplexity_input          # t-SNE perplexity from number slider
learning_rate = learning_rate_input    # t-SNE learning rate from number slider
scale = scale_input                    # Scaling factor for 3D points from slider

# Reading image files
image_files = glob(os.path.join(folder_path, '*.jpg'))  # Fetch all jpg images
num_imgs = len(image_files)  # Count number of images

# Ensure there are images to process
if num_imgs == 0:
    raise ValueError("No images found in the folder.")

# Process images and prepare the stack for PCA
im_stack = []

for img_path in image_files:
    img = cv.imread(img_path)
    if img is not None:
        # Convert to greyscale
        img_gray = color.rgb2gray(img)
        
        # Resize to 256x256
        new_size = (256, 256)
        img_gray = cv.resize(img_gray, new_size, interpolation=cv.INTER_AREA)
        
        # Flatten the image and append to stack
        im_stack.append(img_gray.flatten())

# Convert the stack to a NumPy array
im_stack = np.array(im_stack)

# Perform PCA for dimensionality reduction
pca = PCA(n_components=num_components)
low_matrix = pca.fit_transform(im_stack)

# t-SNE for further reduction to 3D coordinates
tsne = manifold.TSNE(n_components=n_dim, init='pca', random_state=0, perplexity=perplexity, learning_rate=learning_rate)
X_tsne = tsne.fit_transform(low_matrix)  # Apply t-SNE on PCA-reduced data
X_tsne = X_tsne * scale  # Optionally scale the coordinates

# Output: 3D coordinates for each image (to be visualised in Grasshopper)
output_points = X_tsne.tolist()  # Convert NumPy array to list for GH output

# Pass the 3D coordinates to Grasshopper for visualisation as points
pts_output = output_points

# Optionally, print the result
for i, pt in enumerate(pts_output):
    print("Image {} 3D coordinates: {}".format(i+1, pt))

#-------------------------------

# List out all the contents in the folder (no need to modify)
dir_files = os.listdir(folder_path)

dir_output = []
for file in dir_files:
    dir_output.append(os.path.join(folder_path, file))


print(dir_output)
# ---------- end encoder ----------
panel = Panel(encoder.dir_output)
split = TextSplit(Text=panel, Separators="'")  # -> simplify(Result)
panel_2 = Panel(encoder.pts_output)
panel_3 = Panel(split)
partition = PartitionList(List=panel_2, Size=number_slider)
scale = Slider(15, range=0..100)
item = ListItem(List=panel_3, Index="1", Wrap=True)  # -> flatten(Item)
item_2 = ListItem(List=partition, Index=0, Wrap=True)
item_3 = ListItem(List=partition, Index=1, Wrap=True)
item_4 = ListItem(List=partition, Index=2, Wrap=True)
pt = ConstructPoint(XCoordinate=item_2, YCoordinate=item_3, ZCoordinate=item_4)
panel_4 = Panel(item)
box = CenterBox(Base=pt, X=scale, Y=scale, Z=0)
item_5 = ListItem(List=flatten(pt), Index=Slider(7, range=0..10), Wrap=True)
item_6 = ListItem(List=flatten(pt), Index=Slider(542, range=0..1000), Wrap=True)
number_slider_2 = Slider(27, range=0..27)
ln = Line(StartPoint=item_6, EndPoint=item_5)
mat = Material(Surface=flatten(box), String=panel_4, Double=Slider(0, range=0..100))
divide = DivideCurve(Curve=ln, Count=Slider(27, range=0..100), Kinks=False)  # -> Points, Tangents, Parameters
addition = Addition(A=number_slider_2, B=Slider(2, range=0..10))
item_7 = ListItem(List=divide.Points, Index=number_slider_2, Wrap=True)
item_8 = ListItem(List=divide.Points, Index=addition, Wrap=True)
S = Script(CamPos=item_7, TargetPos=item_8, Run=Toggle(True))  # -> out, a; inputs CamPos: Point3d, TargetPos: Point3d, Run: Boolean
# ---------- S: Python ----------
import Rhino

if Run:
    # 1. 强制获取当前激活的 Rhino 真实文档（避开 GH 虚拟环境的混淆）
    doc = Rhino.RhinoDoc.ActiveDoc
    
    # 2. 精确查找名为 "Perspective" 的透视视图
    view = doc.Views.Find("Perspective", False)
    
    if view:
        # 3. 强行覆写相机的 目标点(Target) 和 位置点(Camera)
        # 注意底层 API 的参数顺序是先 Target，后 Camera
        view.ActiveViewport.SetCameraLocations(TargetPos, CamPos)
        
        # 4. 强制刷新视口画面
        view.Redraw()
# ---------- end S ----------
sph = Sphere(Base=item_8, Radius=Slider(1, range=0..10))
